# Grasshopper definition test-file.gh (Grasshopper 1.0.7)
# plug-ins: Mallard

list_airtable_records = ListAirtableRecords(Refresh=Toggle(True), BaseID="appRbs7vdw1fk8A7s", AppKey="keyjNDU2X6XRFOsxc", TableName="Listings", ViewName="Grid view")  # -> ErrorMessage, OutRecords
panel = Panel(list_airtable_records.ErrorMessage)
panel_2 = Panel(list_airtable_records.OutRecords)
